% Simulink data dictionary data.sldd

actuatorCentres = struct(
  aileron=struct(left=0, right=0),
  elevator=struct(left=0, right=0),
  rudder=0,
  flap=struct(left=0, right=0))

deflectionLimits = struct(
  aileron=struct(min=-10, max=10),
  elevator=struct(min=-10, max=10),
  rudder=struct(min=-5, max=5),
  flap=struct(min=0, max=15))

initCond = struct(x0=[0 0 0], v0=[0 0 0], euler0=[0 0 0], w0=[0 0 0])

servoPins = struct(
  aileron=struct(left=9, right=10),
  elevator=struct(left=7, right=8),
  rudder=11,
  flap=struct(left=5, right=6))

States = Simulink.Bus()
  X_e: double[3], Unit="m"
  euler_angles: double[3], Unit="rad"
  V_b: double[3], Unit="m/s"
  omega: double[3], Unit="rad/s"
  omega_dot: double[3], Unit="rad/s^2"
  A_be: double[3], Unit="m/s^2"

initConditions = struct(x0=[0 0 0], v0=[0 0 0], euler0=[0 0 0], w0=[0 0 0])
envConsts = struct(magVar=-1.3, refHeight=0)

Errors = Simulink.Bus()
  PRESS_OOB_ERROR: boolean
  TEMP_OOB_ERROR: boolean
  AIRFRAME_G_LIMIT_EXCEEDED: boolean
  GPS_FIX_BAD: boolean

Sensors = Simulink.Bus()
  Pressure: double, Unit="Pa"
  Temperature: double, Unit="°C"
  omega_dot: double[3], Unit="rad/s^2"
  omega: double[3], Unit="rad/s"
  euler_angles: double[3], Unit="rad"
  A_be: double[3], Unit="m/s^2"
  V_b: double[3], Unit="m/s"
  X_e: double[3], Unit="m"
  Heading: double, Unit="deg"
  GPS_LLA: double[3]
  GPS_GS: double, Unit="kn"
  Altitude: double, Unit="m"

ActuatorStates = Simulink.Bus()
  Aileron: double, Unit="deg"
  Elevator: double, Unit="deg"
  Rudder: double, Unit="deg"
  Flap: double, Unit="deg"

AutoflightDemandedValues = Simulink.Bus()
  FlightMode: Enum: FlightMode
  HoldAltitude: double, Unit="m"
  HoldSpeed: double, Unit="kn"
  HoldHeading: double, Unit="deg"
  LLATarget: double

Uplink = Simulink.Bus()
  AutoflightRefValues: Bus: AutoflightDemandedValues
  ControlOverride: Bus: ControlOverrides

Downlink = Simulink.Bus()
SimType = 0

FlightMode = enum(DefaultValue="manOverride")
  manOverride = 0
  autoclimb = 0
  speedHold = 0
  altHold = 0
  hdgHold = 0

Demands = Simulink.Bus()
  FlightMode: double
  Altitude: double, Unit="m"
  Heading: double, Unit="deg"
  GroundSpeed: double, Unit="m/s"
  PositionTarget: double[2]
  ControlOverrides: Bus: ControlOverrides

Sim_Mode = Simulink.VariantConfigurationData(
  VariantConfigurations=[struct(
    Name="Prelim",
    Description="",
    ControlVariables=[struct(Name="SimType", Value="0", Source="data.sldd"), struct(Name="AeroModel", Value="1", Source="data.sldd")],
    SubModelConfigurations=[]), struct(
    Name="MIL",
    Description="",
    ControlVariables=struct(Name="SimType", Value="1", Source="data.sldd"),
    SubModelConfigurations=[]), struct(
    Name="SIL",
    Description="",
    ControlVariables=struct(Name="SimType", Value="2", Source="data.sldd"),
    SubModelConfigurations=[])],
  DefaultConfigurationName="Prelim")

AeroModel = 1
AERO_MODEL = Simulink.Variant(Condition="AERO_MODEL==2")

vehicle = struct(
  mass=5,
  inertia=[1 0 0; 0 1 0; 0 0 1],
  wingspan=3,
  wingarea=0.2,
  aclength=0.8,
  CG=[0 0 0],
  CP=[0.01 0 -0.001],
  stallSpeed=30,
  thrust=100)

datcom = {struct(
  case="FLAPS: UAV",
  mach=[0.03 0.1],
  alt=[50 300],
  alpha=[-16 -8 -6 -4 -2 0 2 4 8 9 10 12 14 16 18 19 20 21 22 24],
  nmach=2,
  nalt=2,
  nalpha=20,
  rnnub=[],
  hypers=false,
  loop=1,
  sref=6.79,
  cbar=1.15,
  blref=5.9,
  dim="ft",
  deriv="deg",
  stmach=0.6,
  tsmach=1.4,
  save=false,
  stype=[],
  trim=false,
  damp=true,
  build=1,
  part=true,
  highsym=true,
  highasy=false,
  highcon=false,
  tjet=false,
  hypeff=false,
  lb=false,
  pwr=false,
  grnd=false,
  wsspn=2.79,
  hsspn=1,
  ndelta=5,
  delta=[0 5 10 15 20],
  deltal=[],
  deltar=[],
  ngh=0,
  grndht=[],
  config=struct(downwash=false, body=true, wing=true, htail=false, vtail=false, vfin=false),
  version=1976,
  cd=reshape([0.051 0.017 0.014 0.013 0.014 0.016 0.021 0.028 0.05 0.057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], 20, 2, 2),
  cl=reshape([-0.779 -0.254 -0.131 -0.015 0.101 0.223 0.352 0.486 0.765 0.836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], 20, 2, 2),
  cm=reshape([-0.1759 -0.0809 -0.0606 -0.0418 -0.0238 -0.0053 0.0135 0.0326 0.0709 0.0805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], 20, 2, 2),
  cn=reshape([-0.763 -0.254 -0.132 -0.016 0.1 0.223 0.353 0.487 0.764 0.834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], 20, 2, 2),
  ca=reshape([-0.165 -0.018 0.001 0.012 0.017 0.016 0.009 -0.006 -0.057 -0.074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], 20, 2, 2),
  xcp=reshape([0.231 0.319 0.459 2.692 -0.238 -0.024 0.038 0.067 0.093 0.096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], 20, 2, 2),
  cma=reshape([0.01323 0.0105 0.009779 0.0092 0.009121 0.009325 0.009473 0.009552 0.009566 0.009539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], 20, 2, 2),
  cyb=reshape([0 99999 99999 99999 99999 99999 99999 99999 99999 99999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], 20, 2, 2),
  cnb=repmat(99999, 20, 2, 2),
  clb=reshape([0.0007507 0.0001354 -8.116e-6 -0.0001448 -0.00028 -0.0004237 -0.0005746 -0.0007315 -0.001058 -0.001141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], 20, 2, 2),
  cla=reshape([0.06916 0.06213 0.05978 0.05802 0.05951 0.06285 0.06569 0.06785 0.07065 0.07101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], 20, 2, 2),
  clq=reshape([0.004415 99999 99999 99999 99999 99999 99999 99999 99999 99999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], 20, 2, 2),
  cmq=reshape([-0.002706 99999 99999 99999 99999 99999 99999 99999 99999 99999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], 20, 2, 2),
  clad=reshape([NaN 99999 99999 99999 99999 99999 99999 99999 99999 99999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], 20, 2, 2),
  cmad=reshape([NaN 99999 99999 99999 99999 99999 99999 99999 99999 99999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], 20, 2, 2),
  clp=reshape([-0.006911 -0.006174 -0.005938 -0.005763 -0.00591 -0.006244 -0.006531 -0.006753 -0.007057 -0.007101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], 20, 2, 2),
  cyp=reshape([-0.0007963 -0.00026 -0.0001348 -1.506e-5 0.0001035 0.0002288 0.0003599 0.0004959 0.0007784 0.0008506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], 20, 2, 2),
  cnp=reshape([0.001125 0.0003704 0.0001928 2.159e-5 -0.000148 -0.0003256 -0.0005098 -0.0006998 -0.001094 -0.001195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], 20, 2, 2),
  cnr=reshape([-0.0003189 -8.144e-5 -6.078e-5 -5.333e-5 -5.768e-5 -7.509e-5 -0.0001076 -0.0001567 -0.0003092 -0.0003589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], 20, 2, 2),
  clr=reshape([-0.003348 -0.001091 -0.0005643 -6.297e-5 0.0004333 0.0009603 0.001514 0.00209 0.003287 0.003592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], 20, 2, 2),
  wetarea_b=[1.921 99999; 99999 1.921],
  xcg_b=[1.22 99999; 99999 1.22],
  zcg_b=[0.11 99999; 99999 0.11],
  basearea_b=[0.033 99999; 99999 0.033],
  cd0_b=[0.001695 99999; 99999 0.001444],
  basedrag_b=[0.0002593 99999; 99999 0.0002892],
  fricdrag_b=[0.001436 99999; 99999 0.001155],
  presdrag_b=[NaN 99999; 99999 NaN],
  lemac=[0.37 99999; 99999 0.37],
  area_w_tt=[4.839 99999; 99999 4.839],
  taperratio_w_tt=[1 99999; 99999 1],
  aspectratio_w_tt=[7.193 99999; 99999 7.193],
  qcsweep_w_tt=[0 99999; 99999 0],
  mac_w_tt=[0.82 99999; 99999 0.82],
  qcmac_w_tt=[1.06 99999; 99999 1.06],
  ymac_w_tt=[1.48 99999; 99999 1.48],
  cd0_w_tt=[99999 99999; 99999 99999],
  friccoeff_w_tt=[99999 99999; 99999 99999],
  area_w_te=[4.577 99999; 99999 4.577],
  taperratio_w_te=[1 99999; 99999 1],
  aspectratio_w_te=[6.803 99999; 99999 6.803],
  qcsweep_w_te=[0 99999; 99999 0],
  mac_w_te=[0.82 99999; 99999 0.82],
  qcmac_w_te=[1.06 99999; 99999 1.06],
  ymac_w_te=[1.56 99999; 99999 1.56],
  cd0_w_te=[0.0104 99999; 99999 0.00827],
  friccoeff_w_te=[0.0062 99999; 99999 0.00492],
  cla_b_w=[0.003566 99999; 99999 0.003573],
  cla_w_b=[0.05277 99999; 99999 0.05288],
  k_b_w=[0.07051 99999; 99999 0.07051],
  k_w_b=[1.043 99999; 99999 1.043],
  xacc_b_w=[0.1783 99999; 99999 0.1783],
  hiv_b_w=repmat(99999, 20, 2, 2),
  hiv_w_h=repmat(99999, 20, 2, 2),
  hiv_b_h=repmat(99999, 20, 2, 2),
  gamma=reshape([NaN NaN NaN 0 0 0 0 0 NaN NaN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], 20, 2, 2),
  gamma2pialpvr=reshape([NaN NaN NaN NaN NaN NaN NaN NaN NaN NaN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], 20, 2, 2),
  iv_b_w=repmat(0, 20, 2, 2),
  iv_w_h=reshape([NaN NaN NaN NaN NaN NaN NaN NaN NaN NaN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], 20, 2, 2),
  iv_b_h=reshape([NaN NaN NaN NaN NaN NaN NaN NaN NaN NaN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], 20, 2, 2),
  clpgammacl0=[-0.46083 99999; 99999 -0.46153],
  clpgammaclp=[1 99999; 99999 1],
  cnptheta=[-0.00027961 99999; 99999 -0.00027961],
  cypgamma=[0 99999; 99999 0],
  cypcl=[0.069765 99999; 99999 0.06969],
  clbgamma=[-0.0002375 99999; 99999 -0.0002375],
  cmothetaw=[NaN 99999; 99999 NaN],
  cmothetah=[NaN 99999; 99999 NaN],
  dcl_sym=reshape([0 0.127 0.254 0.366 0.393 99999 99999 99999 99999 99999 99999 99999 99999 99999 99999 0 0.133 0.267 0.384 0.413], 5, 2, 2),
  dcm_sym=reshape([0 0.0016 0.0032 0.0053 -0.0042 99999 99999 99999 99999 99999 99999 99999 99999 99999 99999 0 0.0021 0.0042 0.0067 -0.0029], 5, 2, 2),
  dclmax_sym=reshape([0 0.069 0.134 0.187 0.232 99999 99999 99999 99999 99999 99999 99999 99999 99999 99999 0 0.069 0.134 0.187 0.232], 5, 2, 2),
  dcdmin_sym=reshape([1.0e-5 0.00414 0.00937 0.019 0.02706 99999 99999 99999 99999 99999 99999 99999 99999 99999 99999 1.0e-5 0.00419 0.0096 0.01947 0.0276], 5, 2, 2),
  clad_sym=reshape([NaN NaN NaN NaN NaN 99999 99999 99999 99999 99999 99999 99999 99999 99999 99999 NaN NaN NaN NaN NaN], 5, 2, 2),
  cha_sym=reshape([-0.008628 99999 99999 99999 99999 99999 99999 99999 99999 99999 99999 99999 99999 99999 99999 -0.008626 99999 99999 99999 99999], 5, 2, 2),
  chd_sym=reshape([-0.01594 -0.01594 -0.01594 -0.01602 -0.01639 99999 99999 99999 99999 99999 99999 99999 99999 99999 99999 -0.0155 -0.0155 -0.0155 -0.01558 -0.01596], 5, 2, 2),
  dcdi_sym=reshape([-2.07e-5 -7.17e-6 -3.8e-6 -4.33e-7 2.94e-6 6.31e-6 9.68e-6 1.31e-5 1.98e-5 2.15e-5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], 20, 5, 2, 2)), struct(
  case="AILERONS: UAV",
  mach=[0.03 0.1],
  alt=[50 300],
  alpha=[-16 -8 -6 -4 -2 0 2 4 8 9 10 12 14 16 18 19 20 21 22 24],
  nmach=2,
  nalt=2,
  nalpha=20,
  rnnub=[],
  hypers=false,
  loop=1,
  sref=6.79,
  cbar=1.15,
  blref=5.9,
  dim="ft",
  deriv="deg",
  stmach=0.6,
  tsmach=1.4,
  save=false,
  stype=4,
  trim=false,
  damp=true,
  build=1,
  part=true,
  highsym=false,
  highasy=true,
  highcon=false,
  tjet=false,
  hypeff=false,
  lb=false,
  pwr=false,
  grnd=false,
  wsspn=2.79,
  hsspn=1,
  ndelta=9,
  delta=[],
  deltal=[-32 -20 -10 -5 0 5 10 20 32],
  deltar=[32 20 10 5 0 -5 -10 -20 -32],
  ngh=0,
  grndht=[],
  config=struct(downwash=false, body=true, wing=true, htail=false, vtail=false, vfin=false),
  version=1976,
  cd=reshape([0.051 0.017 0.014 0.013 0.014 0.016 0.021 0.028 0.05 0.057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], 20, 2, 2),
  cl=reshape([-0.779 -0.254 -0.131 -0.015 0.101 0.223 0.352 0.486 0.765 0.836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], 20, 2, 2),
  cm=reshape([-0.1759 -0.0809 -0.0606 -0.0418 -0.0238 -0.0053 0.0135 0.0326 0.0709 0.0805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], 20, 2, 2),
  cn=reshape([-0.763 -0.254 -0.132 -0.016 0.1 0.223 0.353 0.487 0.764 0.834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], 20, 2, 2),
  ca=reshape([-0.165 -0.018 0.001 0.012 0.017 0.016 0.009 -0.006 -0.057 -0.074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], 20, 2, 2),
  xcp=reshape([0.231 0.319 0.459 2.692 -0.238 -0.024 0.038 0.067 0.093 0.096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], 20, 2, 2),
  cma=reshape([0.01323 0.0105 0.009779 0.0092 0.009121 0.009325 0.009473 0.009552 0.009566 0.009539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], 20, 2, 2),
  cyb=reshape([0 99999 99999 99999 99999 99999 99999 99999 99999 99999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], 20, 2, 2),
  cnb=repmat(99999, 20, 2, 2),
  clb=reshape([0.0007507 0.0001354 -8.116e-6 -0.0001448 -0.00028 -0.0004237 -0.0005746 -0.0007315 -0.001058 -0.001141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], 20, 2, 2),
  cla=reshape([0.06916 0.06213 0.05978 0.05802 0.05951 0.06285 0.06569 0.06785 0.07065 0.07101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], 20, 2, 2),
  clq=reshape([0.004415 99999 99999 99999 99999 99999 99999 99999 99999 99999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], 20, 2, 2),
  cmq=reshape([-0.002706 99999 99999 99999 99999 99999 99999 99999 99999 99999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], 20, 2, 2),
  clad=reshape([NaN 99999 99999 99999 99999 99999 99999 99999 99999 99999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], 20, 2, 2),
  cmad=reshape([NaN 99999 99999 99999 99999 99999 99999 99999 99999 99999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], 20, 2, 2),
  clp=reshape([-0.006911 -0.006174 -0.005938 -0.005763 -0.00591 -0.006244 -0.006531 -0.006753 -0.007057 -0.007101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], 20, 2, 2),
  cyp=reshape([-0.0007963 -0.00026 -0.0001348 -1.506e-5 0.0001035 0.0002288 0.0003599 0.0004959 0.0007784 0.0008506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], 20, 2, 2),
  cnp=reshape([0.001125 0.0003704 0.0001928 2.159e-5 -0.000148 -0.0003256 -0.0005098 -0.0006998 -0.001094 -0.001195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], 20, 2, 2),
  cnr=reshape([-0.0003189 -8.144e-5 -6.078e-5 -5.333e-5 -5.768e-5 -7.509e-5 -0.0001076 -0.0001567 -0.0003092 -0.0003589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], 20, 2, 2),
  clr=reshape([-0.003348 -0.001091 -0.0005643 -6.297e-5 0.0004333 0.0009603 0.001514 0.00209 0.003287 0.003592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], 20, 2, 2),
  wetarea_b=[1.921 99999; 99999 1.921],
  xcg_b=[1.22 99999; 99999 1.22],
  zcg_b=[0.11 99999; 99999 0.11],
  basearea_b=[0.033 99999; 99999 0.033],
  cd0_b=[0.001695 99999; 99999 0.001444],
  basedrag_b=[0.0002593 99999; 99999 0.0002892],
  fricdrag_b=[0.001436 99999; 99999 0.001155],
  presdrag_b=[NaN 99999; 99999 NaN],
  lemac=[0.37 99999; 99999 0.37],
  area_w_tt=[4.839 99999; 99999 4.839],
  taperratio_w_tt=[1 99999; 99999 1],
  aspectratio_w_tt=[7.193 99999; 99999 7.193],
  qcsweep_w_tt=[0 99999; 99999 0],
  mac_w_tt=[0.82 99999; 99999 0.82],
  qcmac_w_tt=[1.06 99999; 99999 1.06],
  ymac_w_tt=[1.48 99999; 99999 1.48],
  cd0_w_tt=[99999 99999; 99999 99999],
  friccoeff_w_tt=[99999 99999; 99999 99999],
  area_w_te=[4.577 99999; 99999 4.577],
  taperratio_w_te=[1 99999; 99999 1],
  aspectratio_w_te=[6.803 99999; 99999 6.803],
  qcsweep_w_te=[0 99999; 99999 0],
  mac_w_te=[0.82 99999; 99999 0.82],
  qcmac_w_te=[1.06 99999; 99999 1.06],
  ymac_w_te=[1.56 99999; 99999 1.56],
  cd0_w_te=[0.0104 99999; 99999 0.00827],
  friccoeff_w_te=[0.0062 99999; 99999 0.00492],
  cla_b_w=[0.003566 99999; 99999 0.003573],
  cla_w_b=[0.05277 99999; 99999 0.05288],
  k_b_w=[0.07051 99999; 99999 0.07051],
  k_w_b=[1.043 99999; 99999 1.043],
  xacc_b_w=[0.1783 99999; 99999 0.1783],
  hiv_b_w=repmat(99999, 20, 2, 2),
  hiv_w_h=repmat(99999, 20, 2, 2),
  hiv_b_h=repmat(99999, 20, 2, 2),
  gamma=reshape([NaN NaN NaN 0 0 0 0 0 NaN NaN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], 20, 2, 2),
  gamma2pialpvr=reshape([NaN NaN NaN NaN NaN NaN NaN NaN NaN NaN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], 20, 2, 2),
  iv_b_w=repmat(0, 20, 2, 2),
  iv_w_h=reshape([NaN NaN NaN NaN NaN NaN NaN NaN NaN NaN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], 20, 2, 2),
  iv_b_h=reshape([NaN NaN NaN NaN NaN NaN NaN NaN NaN NaN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], 20, 2, 2),
  clpgammacl0=[-0.46083 99999; 99999 -0.46153],
  clpgammaclp=[1 99999; 99999 1],
  cnptheta=[-0.00027961 99999; 99999 -0.00027961],
  cypgamma=[0 99999; 99999 0],
  cypcl=[0.069765 99999; 99999 0.06969],
  clbgamma=[-0.0002375 99999; 99999 -0.0002375],
  cmothetaw=[NaN 99999; 99999 NaN],
  cmothetah=[NaN 99999; 99999 NaN],
  clroll=reshape([-0.056221 -0.047045 -0.030397 -0.015199 0 0.015199 0.030397 0.047045 0.056221 99999 99999 99999 99999 99999 99999 99999 99999 99999 99999 99999 99999 99999 99999 99999 99999 99999 99999 -0.056466 -0.04725 -0.03053 -0.015265 0 0.015265 0.03053 0.04725 0.056466], 9, 2, 2),
  cn_asy=reshape([-0.007974 -0.002598 -0.001344 -0.00015 0.001032 0.002287 0.003606 0.004977 0.007828 0.008554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], 20, 9, 2, 2)), struct(
  case="TOTAL: TOTAL: UAV",
  mach=[0.03 0.1],
  alt=[50 300],
  alpha=[-16 -8 -6 -4 -2 0 2 4 8 9 10 12 14 16 18 19 20 21 22 24],
  nmach=2,
  nalt=2,
  nalpha=20,
  rnnub=[],
  hypers=false,
  loop=1,
  sref=6.79,
  cbar=1.15,
  blref=5.9,
  dim="ft",
  deriv="deg",
  stmach=0.6,
  tsmach=1.4,
  save=false,
  stype=[],
  trim=false,
  damp=true,
  build=1,
  part=true,
  highsym=true,
  highasy=false,
  highcon=false,
  tjet=false,
  hypeff=false,
  lb=false,
  pwr=false,
  grnd=false,
  wsspn=2.79,
  hsspn=0.66,
  ndelta=8,
  delta=[-15 -10 -5 0 5 10 13 16],
  deltal=[],
  deltar=[],
  ngh=0,
  grndht=[],
  config=struct(downwash=true, body=true, wing=true, htail=true, vtail=true, vfin=false),
  version=1976,
  cd=reshape([0.067 0.023 0.019 0.016 0.016 0.018 0.023 0.03 0.054 0.062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], 20, 2, 2),
  cl=reshape([-0.828 -0.284 -0.156 -0.033 0.089 0.216 0.349 0.488 0.777 0.851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], 20, 2, 2),
  cm=reshape([-0.0614 -0.0118 -0.0044 0.0003 0.0038 0.0108 0.0195 0.0273 0.0423 0.046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], 20, 2, 2),
  cn=reshape([-0.814 -0.285 -0.157 -0.034 0.088 0.216 0.35 0.489 0.777 0.85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], 20, 2, 2),
  ca=reshape([-0.163 -0.016 0.002 0.014 0.019 0.018 0.011 -0.004 -0.055 -0.072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], 20, 2, 2),
  xcp=reshape([0.075 0.041 0.028 -0.008 0.043 0.05 0.056 0.056 0.054 0.054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], 20, 2, 2),
  cma=reshape([0.01072 0.004195 0.003017 0.002047 0.002635 0.003928 0.004124 0.003851 0.003708 0.003534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], 20, 2, 2),
  cyb=reshape([-0.001183 99999 99999 99999 99999 99999 99999 99999 99999 99999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], 20, 2, 2),
  cnb=repmat(99999, 20, 2, 2),
  clb=reshape([0.0006016 2.613e-5 -0.0001085 -0.000236 -0.0003617 -0.0004954 -0.0006363 -0.0007835 -0.001091 -0.001169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], 20, 2, 2),
  cla=reshape([0.07094 0.06482 0.06272 0.06116 0.06237 0.06523 0.06805 0.07036 0.07319 0.0736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], 20, 2, 2),
  qqinf=reshape([1 1 1 0.984 0.919 0.899 0.95 0.998 1 1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], 20, 2, 2),
  eps=reshape([-5.315 -1.852 -0.973 -0.112 0.76 1.679 2.597 3.524 5.382 5.85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], 20, 2, 2),
  depsdalp=reshape([0.433 0.438 0.435 0.433 0.448 0.459 0.461 0.464 0.467 0.453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], 20, 2, 2),
  clq=reshape([0.01853 99999 99999 99999 99999 99999 99999 99999 99999 99999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], 20, 2, 2),
  cmq=reshape([-0.03434 99999 99999 99999 99999 99999 99999 99999 99999 99999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], 20, 2, 2),
  clad=reshape([0.006109 0.006181 0.006136 0.006017 0.005807 0.005822 0.006182 0.006533 0.006594 0.006394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], 20, 2, 2),
  cmad=reshape([-0.0137 -0.01386 -0.01376 -0.01349 -0.01302 -0.01305 -0.01386 -0.01465 -0.01478 -0.01433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], 20, 2, 2),
  clp=reshape([-0.006959 -0.006198 -0.005958 -0.005778 -0.005922 -0.006253 -0.006539 -0.006761 -0.007067 -0.007112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], 20, 2, 2),
  cyp=reshape([-0.001046 -0.0003874 -0.0002307 -7.923e-5 7.133e-5 0.0002288 0.0003923 0.0005608 0.0009086 0.000997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], 20, 2, 2),
  cnp=reshape([0.001215 0.0004186 0.0002295 4.634e-5 -0.0001355 -0.0003256 -0.0005225 -0.0007253 -0.001146 -0.001253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], 20, 2, 2),
  cnr=reshape([-0.0006239 -0.0004206 -0.0004068 -0.0004053 -0.0004148 -0.0004366 -0.0004725 -0.0005243 -0.0006794 -0.0007291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], 20, 2, 2),
  clr=reshape([-0.003207 -0.0009884 -0.0004728 1.713e-5 0.0005016 0.001016 0.001558 0.002121 0.003292 0.003591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], 20, 2, 2),
  wetarea_b=[1.921 99999; 99999 1.921],
  xcg_b=[1.22 99999; 99999 1.22],
  zcg_b=[0.11 99999; 99999 0.11],
  basearea_b=[0.033 99999; 99999 0.033],
  cd0_b=[0.001695 99999; 99999 0.001444],
  basedrag_b=[0.0002593 99999; 99999 0.0002892],
  fricdrag_b=[0.001436 99999; 99999 0.001155],
  presdrag_b=[NaN 99999; 99999 NaN],
  lemac=[0.37 99999; 99999 0.37],
  area_w_tt=[4.839 99999; 99999 4.839],
  taperratio_w_tt=[1 99999; 99999 1],
  aspectratio_w_tt=[7.193 99999; 99999 7.193],
  qcsweep_w_tt=[0 99999; 99999 0],
  mac_w_tt=[0.82 99999; 99999 0.82],
  qcmac_w_tt=[1.06 99999; 99999 1.06],
  ymac_w_tt=[1.48 99999; 99999 1.48],
  cd0_w_tt=[99999 99999; 99999 99999],
  friccoeff_w_tt=[99999 99999; 99999 99999],
  area_w_te=[4.577 99999; 99999 4.577],
  taperratio_w_te=[1 99999; 99999 1],
  aspectratio_w_te=[6.803 99999; 99999 6.803],
  qcsweep_w_te=[0 99999; 99999 0],
  mac_w_te=[0.82 99999; 99999 0.82],
  qcmac_w_te=[1.06 99999; 99999 1.06],
  ymac_w_te=[1.56 99999; 99999 1.56],
  cd0_w_te=[0.0104 99999; 99999 0.00827],
  friccoeff_w_te=[0.0062 99999; 99999 0.00492],
  area_ht_tt=[0.5412 99999; 99999 0.5412],
  taperratio_ht_tt=[0.608 99999; 99999 0.608],
  aspectratio_ht_tt=[3.22 99999; 99999 3.22],
  qcsweep_ht_tt=[11 99999; 99999 11],
  mac_ht_tt=[0.418 99999; 99999 0.418],
  qcmac_ht_tt=[3.8 99999; 99999 3.8],
  ymac_ht_tt=[0.303 99999; 99999 0.303],
  cd0_ht_tt=[99999 99999; 99999 99999],
  friccoeff_ht_tt=[99999 99999; 99999 99999],
  area_ht_te=[0.5412 99999; 99999 0.5412],
  taperratio_ht_te=[0.608 99999; 99999 0.608],
  aspectratio_ht_te=[3.22 99999; 99999 3.22],
  qcsweep_ht_te=[11 99999; 99999 11],
  mac_ht_te=[0.418 99999; 99999 0.418],
  qcmac_ht_te=[3.8 99999; 99999 3.8],
  ymac_ht_te=[0.303 99999; 99999 0.303],
  cd0_ht_te=[0.00129 99999; 99999 0.00102],
  friccoeff_ht_te=[0.00704 99999; 99999 0.00559],
  area_vt_tt=[0.3312 99999; 99999 0.3312],
  taperratio_vt_tt=[0.394 99999; 99999 0.394],
  aspectratio_vt_tt=[1.565 99999; 99999 1.565],
  qcsweep_vt_tt=[23 99999; 99999 23],
  mac_vt_tt=[0.489 99999; 99999 0.489],
  qcmac_vt_tt=[3.53 99999; 99999 3.53],
  ymac_vt_tt=[0.468 99999; 99999 0.468],
  cd0_vt_tt=[99999 99999; 99999 99999],
  friccoeff_vt_tt=[99999 99999; 99999 99999],
  area_vt_te=[0.3312 99999; 99999 0.3312],
  taperratio_vt_te=[0.394 99999; 99999 0.394],
  aspectratio_vt_te=[1.565 99999; 99999 1.565],
  qcsweep_vt_te=[23 99999; 99999 23],
  mac_vt_te=[0.489 99999; 99999 0.489],
  qcmac_vt_te=[3.53 99999; 99999 3.53],
  ymac_vt_te=[0.308 99999; 99999 0.308],
  cd0_vt_te=[0.000759 99999; 99999 0.000603],
  friccoeff_vt_te=[0.00684 99999; 99999 0.00543],
  cla_b_w=[0.003566 99999; 99999 0.003573],
  cla_w_b=[0.05277 99999; 99999 0.05288],
  k_b_w=[0.07051 99999; 99999 0.07051],
  k_w_b=[1.043 99999; 99999 1.043],
  xacc_b_w=[0.1783 99999; 99999 0.1783],
  cla_b_h=[0 99999; 99999 0],
  cla_h_b=[0.003147 99999; 99999 0.003138],
  k_b_h=[0 99999; 99999 0],
  k_h_b=[1 99999; 99999 1],
  xacc_b_h=[0.1102 99999; 99999 0.1102],
  sidewash=[0.61140424 99999; 99999 0.61140424],
  hiv_b_w=repmat(99999, 20, 2, 2),
  hiv_w_h=repmat(99999, 20, 2, 2),
  hiv_b_h=repmat(99999, 20, 2, 2),
  gamma=reshape([NaN NaN NaN 0 0 0 0 0 NaN NaN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], 20, 2, 2),
  gamma2pialpvr=reshape([1.084 0.4918 0.406 0 0 0 0 0 0.4918 0.5661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], 20, 2, 2),
  iv_b_w=repmat(0, 20, 2, 2),
  iv_w_h=reshape([99999 99999 99999 99999 99999 99999 99999 99999 99999 99999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], 20, 2, 2),
  iv_b_h=reshape([-0.2595 -0.08325 -0.003164 0 0 0 0 0 -0.08325 -0.1385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], 20, 2, 2),
  clpgammacl0=[-0.46083 99999; 99999 -0.46153],
  clpgammaclp=[1 99999; 99999 1],
  cnptheta=[-0.00027961 99999; 99999 -0.00027961],
  cypgamma=[0 99999; 99999 0],
  cypcl=[0.069765 99999; 99999 0.06969],
  clbgamma=[-0.0002375 99999; 99999 -0.0002375],
  cmothetaw=[NaN 99999; 99999 NaN],
  cmothetah=[NaN 99999; 99999 NaN],
  dcl_sym=reshape([-0.025 -0.017 -0.009 0 0.009 0.017 0.022 0.027 99999 99999 99999 99999 99999 99999 99999 99999 99999 99999 99999 99999 99999 99999 99999 99999 -0.027 -0.018 -0.009 0 0.009 0.018 0.023 0.028], 8, 2, 2),
  dcm_sym=reshape([0.0764 0.0523 0.0261 -0.0001 -0.0261 -0.0523 -0.0672 -0.0806 99999 99999 99999 99999 99999 99999 99999 99999 99999 99999 99999 99999 99999 99999 99999 99999 0.0802 0.0549 0.0274 -0.0001 -0.0274 -0.0549 -0.0706 -0.0846], 8, 2, 2),
  dclmax_sym=reshape([0.03 0.021 0.011 0 0.011 0.021 0.026 0.031 99999 99999 99999 99999 99999 99999 99999 99999 99999 99999 99999 99999 99999 99999 99999 99999 0.03 0.021 0.011 0 0.011 0.021 0.026 0.031], 8, 2, 2),
  dcdmin_sym=reshape([0.00115 0.00046 0.00023 0 0.00023 0.00046 0.00088 0.00131 99999 99999 99999 99999 99999 99999 99999 99999 99999 99999 99999 99999 99999 99999 99999 99999 0.00115 0.00046 0.00023 0 0.00023 0.00046 0.00088 0.00131], 8, 2, 2),
  clad_sym=reshape([NaN NaN NaN NaN NaN NaN NaN NaN 99999 99999 99999 99999 99999 99999 99999 99999 99999 99999 99999 99999 99999 99999 99999 99999 NaN NaN NaN NaN NaN NaN NaN NaN], 8, 2, 2),
  cha_sym=reshape([-0.002178 99999 99999 99999 99999 99999 99999 99999 99999 99999 99999 99999 99999 99999 99999 99999 99999 99999 99999 99999 99999 99999 99999 99999 -0.002341 99999 99999 99999 99999 99999 99999 99999], 8, 2, 2),
  chd_sym=reshape([-0.006293 -0.006248 -0.006248 -0.006248 -0.006248 -0.006248 -0.006265 -0.006317 99999 99999 99999 99999 99999 99999 99999 99999 99999 99999 99999 99999 99999 99999 99999 99999 -0.006178 -0.006128 -0.006128 -0.006128 -0.006128 -0.006128 -0.006147 -0.006203], 8, 2, 2),
  dcdi_sym=reshape([0.00399 0.00229 0.00187 0.00144 0.00102 0.000614 0.000208 -0.000194 -0.000997 -0.0012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], 20, 8, 2, 2))}

Commands = Simulink.Bus()
  Aileron: single, Unit="deg"
  Elevator: single, Unit="deg"
  Rudder: single, Unit="deg"
  Flap: single, Unit="deg"
  Throttle: single

ControlOverrides = Simulink.Bus()
  Aileron: double
  Elevator: double
  Flap: double
  Throttle: double
  Rudder: double